# Grasshopper definition slicer.gh (Grasshopper 1.0.7)

shrinkage = Slider(0, range=0..1)
layer_height = Slider(0.2, range=0..1)
initial_layer_height = Slider(0.1, range=0..1)
extrude_width = Slider(0.4, range=0..2.5)
nozzle_width = Slider(6, range=1..15)
nozzle_height = Slider(14, range=0..30)
wall_mode = BooleanToggle(False)
fill_bottom = BooleanToggle(False)
walls = Slider(4, range=1..50)
bottom_layers = Slider(4, range=1..50)
geo = Geometry(<brep referenced from the Rhino model>)
pt = Point(<point referenced from the Rhino model>)
dam = DataDam(DataA=shrinkage, BufferDelay=10000000, BufferMode=0)
shrink_resize = ShrinkResize(relay=geo, x=dam)
dam_2 = DataDam(
    InitialLayerHeight=initial_layer_height,
    DataExtrudeWidth=extrude_width,
    DataNozzleWidth=nozzle_width,
    DataNozzleHeight=nozzle_height,
    DataWall_mode=wall_mode,
    DataFill_bottom=fill_bottom,
    DataWalls=walls,
    DataBottom_layers=bottom_layers,
    DataStart_point=pt,
    BufferDelay=10000000,
    BufferMode=0)  # -> DataInitialLayerHeight, DataExtrudeWidth, DataNozzleWidth, DataNozzleHeight, DataWall_mode, DataFill_bottom, DataWalls, DataBottom_layers, DataStart_point
dam_3 = DataDam(DataModel=flatten(shrink_resize), DataLayerHeight=layer_height, BufferDelay=10000000, BufferMode=0)  # -> DataModel, DataLayerHeight
trigger = Trigger(Interval=-1000, TimerInterval=1000, Target=python)
python = GhPythonScript()  # -> out, file
# ---------- python: Python ----------
import rhinoscriptsyntax as rs

filter = "GCode (*.gcode)|*.gcode|All Files (*.*)|*.*||"
file = rs.SaveFileName("", filter)
# ---------- end python ----------
contour = Contour(Shape=flatten(dam_3.DataModel), Point=Point(0, 0, 0), Direction=Vector(0, 0, 1), Distance=dam_3.DataLayerHeight)
dam_4 = DataDam(DataA=python.file, BufferDelay=10000000, BufferMode=0)
python_2 = GhPythonScript(
    filename=dam_4,
    shape=flatten(dam_3.DataModel),
    contour_tree=contour,
    layer_height=dam_3.DataLayerHeight,
    initial_layer_height=dam_2.DataInitialLayerHeight,
    extrude_width=dam_2.DataExtrudeWidth,
    nozzle_width=dam_2.DataNozzleWidth,
    nozzle_height=dam_2.DataNozzleHeight,
    wall_mode=dam_2.DataWall_mode,
    fill_bottom=dam_2.DataFill_bottom,
    walls=dam_2.DataWalls,
    bottom_layers=dam_2.DataBottom_layers,
    start_point=dam_2.DataStart_point)  # -> out, lines, turtle, print_bed, outer_travel, inner_travel; inputs contour_tree: tree of Curve, start_point: Point3d
# ---------- python_2: Python ----------
# code required so that library reloads appropriately
# must be above other import statements
import sys
import math
import time
import operator as op
import ghpythonlib.treehelpers as th
to_delete = list()
for module in sys.modules:
    if "Node" in module:
      to_delete.append(module)
    if "Grid" in module:
      to_delete.append(module)
    if "Graph" in module:
      to_delete.append(module)
    if "contour_utils" in module:
      to_delete.append(module)
    if "geometry_utils" in module:
      to_delete.append(module)
    if "vertical_utils" in module:
      to_delete.append(module)
    if "slicing_utils" in module:
      to_delete.append(module)
    if "extruder_turtle" in module:
      to_delete.append(module)
    if "turtle_utilities" in module:
      to_delete.append(module)
for module in to_delete:
    sys.modules.pop(module)

import slicing_utils
from slicing_utils import *

import vertical_utils
from vertical_utils import *

import extruder_turtle
from extruder_turtle import *

import turtle_utilities as tu

import Rhino
import rhinoscriptsyntax as rs

reload(slicing_utils)
reload(extruder_turtle)


# Main code
# set up the turtle
t = ExtruderTurtle()

metal=True

# metal settings
if metal:
    t.setup(filename=filename, printer = "eazao")
    t.set_material("metal")

    t.set_speed(1800)
    t.set_nozzle_size(0.6)
    t.set_layer_height(0.3)
    #t.set_initial_layer_height(1.5)
    t.set_mix_factor(0.96)
    t.set_extrude_rate(0.25)
    t.set_extrude_width(.8)
    
    t.print_printer_information()
    print("nozzle height: "+str(nozzle_height))
    print("nozzle width: "+str(nozzle_width))
else:
    t.setup(filename=filename, printer = "ender")
    bed_temp = 60.0
    extrude_rate = 0.033
    extruder_temp = 225.0

    t.set_speed(1000)
    t.set_extrude_rate(extrude_rate)
    t.set_extruder_temp(extruder_temp)
    t.set_bed_temp(bed_temp)

    t.set_layer_height(layer_height)
    t.set_extrude_width(extrude_width)
    #t.set_initial_layer_height(initial_layer_height)

    t.print_printer_information()
    print("nozzle height: "+str(nozzle_height))
    print("nozzle width: "+str(nozzle_width))
    print("bed temp: "+str(bed_temp))
    print("extruder temp: "+str(extruder_temp))


t.set_nozzle_height(nozzle_height)
t.set_nozzle_width(nozzle_width)


if start_point != None:
    t.pen_up()
    t.set_position(start_point.X, start_point.Y, 0)
    t.pen_down()

curves = []
for i in range(contour_tree.BranchCount):
    crvs = [crv for crv in contour_tree.Branch(i) if crv and rs.IsCurveClosed(crv)]
    if len(crvs) > 0: curves.append(crvs)

for i in range(len(curves)):
    rs.MoveObject(curves[i], rs.CreateVector(0, 0, initial_layer_height))

# draw
outer_travel, inner_travel, tree, path, edges = slice_vertical_and_fermat_fill(t, shape, curves, wall_mode=wall_mode, walls=walls, fill_bottom=fill_bottom, bottom_layers=bottom_layers, initial_offset=0.5)

#initial_curves = curves[10]
#groups = get_curves(shape, rs.CurveStartPoint(initial_curves[0]).Z, initial_curves=initial_curves)
#inner_travel = connect_curve_groups(groups, float(extrude_width)*0.125, initial_offset=float(extrude_width)*0.5)



# visualize the turtle's path
turtle = t.draw_turtle()
lines = t.get_lines()
print_bed = t.draw_print_bed()


# close the generated .gcode file
t.finish()

print("Print time: "+str(t.get_print_time()))
# ---------- end python_2 ----------
crv = Curve(python_2.lines)
geo_2 = Geometry(python_2.turtle)
srf = Surface(python_2.print_bed)
crv_2 = Curve(python_2.outer_travel)
crv_3 = Curve(python_2.inner_travel)
panel = Panel(python_2.out)

# ==== cluster ShrinkResize
relay = ClusterInput()
x = ClusterInput()
area = Area(Geometry=relay)  # -> Area, Centroid
eval = Evaluate(F="1/(1-x)", x=x)
pt2num = PointsToNumbers(Points=area.Centroid, Mask=4)
item = ListItem(List=pt2num, Index=0, Wrap=True)
item_2 = ListItem(List=pt2num, Index=1, Wrap=True)
vec = VectorXYZ(XComponent=item, YComponent=item_2, ZComponent=0)  # -> Vector, Length
scale = Scale(Geometry=relay, Center=vec.Vector, Factor=eval)  # -> Geometry, Transform
G = ClusterOutput(scale.Geometry)
