# Grasshopper definition slicer_visualizer.gh (Grasshopper 1.0.7)

shrinkage = Slider(0, range=0..1)
geo = Geometry(<brep referenced from the Rhino model>)
center_on_print_bed = CenterOnPrintBed(C=geo)
dam = DataDam(DataA=shrinkage, BufferDelay=10000000, BufferMode=0)
fmerge = MergeFaces(Brep=center_on_print_bed)  # -> Breps, Before, After
shrink_resize = ShrinkResize(relay=geo, x=dam)
extrude_width = Slider(0.4, range=0..2.5)
nozzle_width = Slider(6, range=1..15)
nozzle_height = Slider(14, range=0..30)
layer_height = Slider(0.3, range=0..1)
trigger = Trigger(Interval=-1000, TimerInterval=1000, Target=python)
pt = Point(<point referenced from the Rhino model>)
dam_2 = DataDam(DataModel=flatten(shrink_resize), DataLayerHeight=layer_height, BufferDelay=10000000, BufferMode=0)  # -> DataModel, DataLayerHeight
python = GhPythonScript()  # -> out, file
# ---------- python: Python ----------
import rhinoscriptsyntax as rs

filter = "GCode (*.gcode)|*.gcode|All Files (*.*)|*.*||"
file = rs.SaveFileName("", filter)
# ---------- end python ----------
dam_3 = DataDam(
    DataExtrudeWidth=extrude_width,
    DataNozzleWidth=nozzle_width,
    DataNozzleHeight=nozzle_height,
    DataC=pt,
    BufferDelay=10000000,
    BufferMode=0)  # -> DataExtrudeWidth, DataNozzleWidth, DataNozzleHeight, DataC
crv = Curve(<curve referenced from the Rhino model>)
dam_4 = DataDam(DataA=python.file, BufferDelay=10000000, BufferMode=0)
contour = Contour(Shape=flatten(dam_2.DataModel), Point=Point(0, 0, 0), Direction=Vector(0, 0, 1), Distance=dam_2.DataLayerHeight)
python_2 = GhPythonScript(
    filename=dam_4,
    shape=flatten(dam_2.DataModel),
    contour_tree=contour,
    layer_height=dam_2.DataLayerHeight,
    extrude_width=dam_3.DataExtrudeWidth,
    nozzle_width=dam_3.DataNozzleWidth,
    nozzle_height=dam_3.DataNozzleHeight,
    start_point=dam_3.DataC,
    x=crv)  # -> out, lines, turtle, print_bed, outer_travel, inner_travel, splits, tree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; inputs contour_tree: tree of Curve, start_point: Point3d
# ---------- python_2: Python ----------
# code required so that library reloads appropriately
# must be above other import statements
import sys
import math
import time
import operator as op
import ghpythonlib.treehelpers as th
to_delete = list()
for module in sys.modules:
    if "tree_utils" in module:
      to_delete.append(module)
    if "graph_utils" in module:
      to_delete.append(module)
    if "image_utils" in module:
      to_delete.append(module)
    if "contour_utils" in module:
      to_delete.append(module)
    if "geometry_utils" in module:
      to_delete.append(module)
    if "vertical_utils" in module:
      to_delete.append(module)
    if "slicing_utils" in module:
      to_delete.append(module)
    if "extruder_turtle" in module:
      to_delete.append(module)
    if "turtle_utilities" in module:
      to_delete.append(module)
for module in to_delete:
    sys.modules.pop(module)

import slicing_utils
from slicing_utils import *

import vertical_utils
from vertical_utils import *

import extruder_turtle
from extruder_turtle import *

import turtle_utilities as tu

import Rhino
import rhinoscriptsyntax as rs

reload(slicing_utils)
reload(extruder_turtle)


# Main code
# set up the turtle
t = ExtruderTurtle()

metal=True

# metal settings
if metal:
    t.setup(filename=filename, printer = "eazao")
    t.set_material("metal")

    t.set_speed(1800)
    t.set_nozzle_size(0.6)
    t.set_layer_height(0.3)
    t.set_mix_factor(0.96)
    t.set_extrude_rate(0.25)
    t.set_extrude_width(.8*0.8)
    
    t.print_printer_information()
    print("nozzle height: "+str(nozzle_height))
    print("nozzle width: "+str(nozzle_width))
else:
    t.setup(filename=filename, printer = "ender")
    bed_temp = 60.0
    extrude_rate = 0.033
    extruder_temp = 225.0

    t.set_speed(1000)
    t.set_extrude_rate(extrude_rate)
    t.set_extruder_temp(extruder_temp)
    t.set_bed_temp(bed_temp)

    t.set_layer_height(layer_height)
    t.set_extrude_width(extrude_width)
    
    t.print_printer_information()
    print("nozzle height: "+str(nozzle_height))
    print("nozzle width: "+str(nozzle_width))
    print("bed temp: "+str(bed_temp))
    print("extruder temp: "+str(extruder_temp))


t.set_nozzle_height(nozzle_height)
t.set_nozzle_width(nozzle_width)


if start_point != None:
    t.pen_up()
    t.set_position(start_point.X, start_point.Y, 0)
    t.pen_down()

curves = []
for i in range(contour_tree.BranchCount):
    curves.append([crv for crv in contour_tree.Branch(i)])

print(shape)

# draw
#tree, node_path, path, edges = best_vertical_path(t, shape, curves)
#outer_travel, inner_travel, tree, path, edges = slice_vertical_and_fermat_fill(t, shape, curves, wall_mode=True, walls=3, fill_bottom=True, bottom_layers=5, initial_offset=0.5)

#crvs = get_curves(shape, 0.0, initial_curves=curves[0])
#crv = connect_curves(crvs[0], float(t.get_extrude_width()/8.0))
#travel = get_contours(t, crv, initial_offset=0.0)[1]

#travel = []
#crv = get_isocontour(x, 3.0, x)
#if crv: travel = travel + crv
#crv = get_isocontour(crv, 0.3, crv)
#if crv: travel = travel + crv
#print(travel)

# visualize nozzle height splits
splits = []
bb = rs.BoundingBox(shape)
surf = rs.AddSrfPt([bb[0], bb[1], bb[2], bb[3]])
rs.MoveObject(surf, [0, 0, -bb[0].Z])
nozzle_height = t.get_nozzle_height()
#for z_e in range(int(math.floor(bb[4].Z / nozzle_height)+1)):
#    splits.append(rs.CopyObject(surf, [0,0,z_e*nozzle_height]))


# visualize edges in graph
#edge_start = [rs.CurveStartPoint(edge) for edge in edges]
#edge_end = [rs.CurveEndPoint(edge) for edge in edges]


# visualize the turtle's path
#turtle = t.draw_turtle()
turtle = t
lines = t.get_lines()
print_bed = t.draw_print_bed()


# close the generated .gcode file
t.finish()

print("Print time: "+str(t.get_print_time()))
# ---------- end python_2 ----------
crv_2 = Curve(python_2.lines)
srf = Surface(python_2.print_bed)
crv_3 = Curve(python_2.outer_travel)
geo_2 = Geometry(python_2.splits)
crv_4 = Curve(python_2.inner_travel)
pt_2 = Point(python_2.center_points)
geo_3 = Geometry(python_2.bounding_boxes)
panel = Panel(python_2.out)
geo_4 = Geometry(<brep referenced from the Rhino model>)
subtraction = Subtraction(A=python_2.edge_end, B=python_2.edge_start)
contour_2 = Contour(Shape=flatten(geo_4), Point=Point(0, 0, 0), Direction=Vector(0, 0, 1), Distance=layer_height)
vdis = VectorDisplay(Anchor=python_2.edge_start, Vector=subtraction)
python_3 = GhPythonScript(t=python_2.turtle, shape=geo_4, contour_tree=contour_2)  # -> out, print_lines, print_lines_2, true_travel_lines, true_travel_lines_2, inner_travel, outer_travel; inputs contour_tree: tree; disabled
# ---------- python_3: Python ----------
import sys

to_delete = list()
for module in sys.modules:
    if "tree_utils" in module:
      to_delete.append(module)
    if "graph_utils" in module:
      to_delete.append(module)
    if "image_utils" in module:
      to_delete.append(module)
    if "contour_utils" in module:
      to_delete.append(module)
    if "geometry_utils" in module:
      to_delete.append(module)
    if "vertical_utils" in module:
      to_delete.append(module)
    if "slicing_utils" in module:
      to_delete.append(module)
    if "extruder_turtle" in module:
      to_delete.append(module)
    if "gcode_utilities" in module:
      to_delete.append(module)
    if "turtle_utilities" in module:
      to_delete.append(module)
for module in to_delete:
    sys.modules.pop(module)

import math
import time
import operator as op
import ghpythonlib.treehelpers as th

import slicing_utils
from slicing_utils import *

import vertical_utils
from vertical_utils import *

import extruder_turtle
from extruder_turtle import *

import gcode_utilities as gu
import turtle_utilities as tu

import Rhino
import rhinoscriptsyntax as rs

reload(slicing_utils)
reload(extruder_turtle)

file = '/Users/school/Desktop/Assistantship/3D Printing/Gcode/cura_zig_zag_metal.gcode'
file2 = '/Users/school/Desktop/Assistantship/3D Printing/Gcode/zig_zag_metal.gcode'

layer_height = t.get_layer_height()
extrude_width = t.get_extrude_width()

layer_groups = []
for i in range(contour_tree.BranchCount):
    crvs = [crv for crv in contour_tree.Branch(i)]
    layer_groups.append(get_curves(shape, i*layer_height, initial_curves=crvs))

print_lines, travel_lines, true_travel_lines, number_true_travels, true_travel_length = gu.parse_gcode(file,relative_position=False, travel_length=4*extrude_width)
print_lines_2, travel_lines_2, true_travel_lines_2, number_true_travels_2, true_travel_length_2 = gu.parse_gcode(file2,relative_position=True, travel_length=4*extrude_width)

all_line_length = 0
for line in travel_lines:
    all_line_length = all_line_length + rs.CurveLength(line)
print(all_line_length, true_travel_length)
for line in print_lines:
    all_line_length = all_line_length + rs.CurveLength(line)

approx_print_time = (all_line_length)/1800
print("Approximate print time: "+str(approx_print_time))

true_travel_lines = rs.JoinCurves(true_travel_lines)

inner_travel = []
outer_travel = []
check_travel_types = False
if check_travel_types:
    for trav in true_travel_lines:
        if rs.CurveLength(trav) > 2.5*extrude_width:

            z = rs.CurveStartPoint(trav).Z
            trav_points = rs.PolylineVertices(trav)
            for pnt in trav_points: pnt.Z = z
            try:
                trav = rs.AddPolyline(trav_points)
            except:
                print("Unable to add polyline", trav_points)

            idx = min(int(z/layer_height)-1, len(layer_groups)-1)
            layer = layer_groups[idx]
            intersect = 0
            for crvs in layer:
                for crv in crvs:
                    if xy_bbox_overlap(trav, crv, width=0) and rs.PlanarCurveCollision(trav, crv):
                        intersect = intersect+1
                        break
                if intersect > 1: break
                
            if intersect > 1:
                outer_travel.append(trav)
            else:
                inner_travel.append(trav)

    print("Number of outer travel movements: "+str(len(outer_travel)))
    print("Number of inner travel movements: "+str(len(inner_travel)))
else:
    print("Did not check for number of outer and inner travel movements.")
# ---------- end python_3 ----------
python_4 = GhPythonScript(t=python_2.turtle, lines=python_2.lines, outer_travel=crv_3, inner_travel=crv_4)  # -> out, a; inputs lines: list, outer_travel: list, inner_travel: list
# ---------- python_4: Python ----------
__author__ = "school"

import rhinoscriptsyntax as rs

total_time = 0
travel_length = 0
travel_speed = t.get_speed()
extrude_width = t.get_extrude_width()
if t.get_printer() == "ender":
    travel_speed = 9000

outer_count = 0
for outer in outer_travel:
    crv_length = rs.CurveLength(outer)
    if crv_length > 2.5*extrude_width:
        outer_count = outer_count + 1
        travel_length = travel_length + crv_length
    total_time = total_time + crv_length / travel_speed

inner_count = 0
for inner in inner_travel:
    crv_length = rs.CurveLength(inner)
    if crv_length > 2.5*extrude_width:
        inner_count = inner_count + 1
        travel_length = travel_length + crv_length
    total_time = total_time + crv_length / travel_speed

speed = t.get_speed()
for line in lines:
    crv_length = rs.CurveLength(line)
    total_time = total_time + crv_length / speed

print("Number of outer model travel movements: "+str(outer_count))
print("Number of inner model travel movements: "+str(inner_count))
print("Length of all travel movements: "+str(travel_length))
print("Total print time: "+str(total_time))
# ---------- end python_4 ----------
panel_2 = Panel(python_4.out)
crv_5 = Curve(python_3.print_lines)
crv_6 = Curve(python_3.print_lines_2)
crv_7 = Curve(python_3.true_travel_lines)
crv_8 = Curve(python_3.true_travel_lines_2)
crv_9 = Curve(python_3.inner_travel)
crv_10 = Curve(python_3.outer_travel)
panel_3 = Panel(python_3.out)

# ==== cluster ShrinkResize
relay = ClusterInput()
x = ClusterInput()
area = Area(Geometry=relay)  # -> Area, Centroid
eval = Evaluate(F="1/(1-x)", x=x)
pt2num = PointsToNumbers(Points=area.Centroid, Mask=4)
item = ListItem(List=pt2num, Index=0, Wrap=True)
item_2 = ListItem(List=pt2num, Index=1, Wrap=True)
vec = VectorXYZ(XComponent=item, YComponent=item_2, ZComponent=0)  # -> Vector, Length
scale = Scale(Geometry=relay, Center=vec.Vector, Factor=eval)  # -> Geometry, Transform
G = ClusterOutput(scale.Geometry)

# ==== cluster CenterOnPrintBed
C = ClusterInput()
bbox = BoundingBox(Content=C, Plane=PlaneXY(0, 0, 0))  # -> Box, Box_2
debrep = DeconstructBrep(Brep=bbox.Box)  # -> Faces, Edges, Vertices
item = ListItem(List=debrep.Vertices, Index=0, Wrap=True)
item_2 = ListItem(List=debrep.Vertices, Index=2, Wrap=True)
subtraction = Subtraction(A=item_2, B=item)
vec = VectorXYZ(XComponent=0, YComponent=0, ZComponent=0)  # -> Vector, Length
multiplication = Multiplication(A=subtraction, B=0.5)
addition = Addition(A=multiplication, B=item)
subtraction_2 = Subtraction(A=vec.Vector, B=addition)
move = Move(Geometry=C, Motion=subtraction_2)  # -> Geometry, Transform
G = ClusterOutput(move.Geometry)
