# Grasshopper definition slicer.gh (Grasshopper 1.0.7)

outer = Slider(20, range=20..40)
points = Slider(24, range=10..30)
inner = Slider(6, range=1..10)
python = GhPythonScript(inner_radius=inner, outer_radius=outer, num_points=points)  # -> curve, points
# ---------- python: Python ----------
import math
import random
import rhinoscriptsyntax as rs

points = []
for p in range(int(num_points)):
    theta = p * (2 * math.pi / num_points)
    length = inner_radius + (random.random() * (outer_radius - inner_radius))
    x = length*math.cos(theta)
    y = length*math.sin(theta)
    points.append(rs.AddPoint([x, y, 0]))

points.append(points[0])
# ---------- end python ----------
geo = Geometry(<brep referenced from the Rhino model>)
area = Area(Geometry=geo)  # -> Area, Centroid
eval = Evaluate(F="1/(1-x)", x=Slider(0.12, range=0..1))
trigger = Trigger(Interval=-1000, TimerInterval=1000, Target=python_2)
vec = VectorXYZ(XComponent=0, YComponent=0, ZComponent=Slider(5, range=1..10))  # -> Vector, Length
intcrv = Interpolate(Vertices=python.points, Degree=3, Periodic=False, KnotStyle=1)  # -> Curve, Length, Domain
crv = Curve(<curve referenced from the Rhino model>)
pt2num = PointsToNumbers(Points=area.Centroid, Mask=4)
item = ListItem(List=pt2num, Index=0, Wrap=True)
item_2 = ListItem(List=pt2num, Index=1, Wrap=True)
extr = Extrude(Base=crv, Direction=vec.Vector)
pt = Point(<point referenced from the Rhino model>)
python_2 = GhPythonScript()  # -> out, file
# ---------- python_2: Python ----------
import rhinoscriptsyntax as rs

filter = "GCode (*.gcode)|*.gcode|All Files (*.*)|*.*||"
file = rs.SaveFileName("", filter)
# ---------- end python_2 ----------
vec_2 = VectorXYZ(XComponent=item, YComponent=item_2, ZComponent=0)  # -> Vector, Length
crv_2 = Curve([<curve referenced from the Rhino model> x2])
scale = Scale(Geometry=geo, Center=vec_2.Vector, Factor=eval)  # -> Geometry, Transform
cap = CapHoles(Brep=extr)
dam = DataDam(DataA=python_2.file, BufferDelay=10000000, BufferMode=0)
dam_2 = DataDam(DataB=scale.Geometry, DataC=pt, DataA=crv_2, BufferDelay=10000000, BufferMode=0)  # -> DataB, DataC, DataA
geo_2 = Geometry(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)
python_3 = GhPythonScript(filename=dam, shape=dam_2.DataB, start_point=dam_2.DataC, curves=dam_2.DataA)  # -> out, lines, turtle, print_bed, travel, tree, path, edge_start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; inputs shape: Brep, start_point: Point3d, curves: list
# ---------- python_3: Python ----------
# code required so that library reloads appropriately
# must be above other import statements
import sys
import math
import time
import operator as op
to_delete = list()
for module in sys.modules:
    if "tree_utils" in module:
      to_delete.append(module)
    if "graph_utils" in module:
      to_delete.append(module)
    if "image_utils" in module:
      to_delete.append(module)
    if "contour_utils" in module:
      to_delete.append(module)
    if "geometry_utils" in module:
      to_delete.append(module)
    if "vertical_utils" in module:
      to_delete.append(module)
    if "slicing_utils" in module:
      to_delete.append(module)
    if "extruder_turtle" in module:
      to_delete.append(module)
    if "turtle_utilities" in module:
      to_delete.append(module)
for module in to_delete:
    sys.modules.pop(module)

import slicing_utils
from slicing_utils import *

import vertical_utils
from vertical_utils import *

import extruder_turtle
from extruder_turtle import *

import turtle_utilities as tu

import Rhino
import rhinoscriptsyntax as rs

reload(slicing_utils)
reload(extruder_turtle)


# Main code
# set up the turtle
t = ExtruderTurtle()
t.setup(filename=filename, printer = "eazao")

t.set_speed(800)
t.set_mix_factor(0.96)
t.set_layer_height(0.45)
t.set_extrude_rate(0.25)
t.set_extrude_width(0.9)

print("standard layer height is: " +str(t.get_layer_height()))
print("standard extrusion width is: "+str(t.get_extrude_width()))

if start_point != None:
    t.pen_up()
    t.set_position(start_point.X, start_point.Y, 0)
    t.pen_down()

# draw
#travel = slice_fermat_fill(t, shape)
#travel = slice_fermat_fill(t, shape, wall_mode=True, walls=2)
#travel = slice_fermat_fill(t, shape, start=6, end=9)
#travel = slice_spiral_fill(t, shape, start=6, end=9)
#travel = slice_contour_fill(t, shape, start=5, end=7)
#travel = slice_2_half_D_fermat(t, curves, layers=1)
#tree, path, center_points, bounding_boxes, edges = best_vertical_path(t, shape)
travel, tree, path, center_points, bounding_boxes, edges = slice_vertical_and_fermat_fill(t, shape, wall_mode=True, walls=4, fill_bottom=False)

edge_start = [rs.CurveStartPoint(edge) for edge in edges]
edge_end = [rs.CurveEndPoint(edge) for edge in edges]


#travel = []
#all_nodes = tree.get_all_nodes([])
#for node in all_nodes:
#    for sub in node.sub_nodes:
#        travel = travel + sub.data

# visualize the turtle's path
#turtle = t.draw_turtle()
lines = t.get_lines()
print_bed = t.draw_print_bed()

# close the generated .gcode file
t.finish()
# ---------- end python_3 ----------
python_4 = GhPythonScript(path=python_3.path, center_points=python_3.center_points, index=Slider(25, range=1..200), nozzle=geo_2)  # -> travel, new_nozzle; inputs path: list, center_points: list, index: Int32
# ---------- python_4: Python ----------
__author__ = "school"

import rhinoscriptsyntax as rs

travel = []

print(path)

for node in path:
    for sub in node.data.sub_nodes:
        travel.append(sub.start_point)

new_nozzle = rs.CopyObject(nozzle, translation=travel[min(index, len(travel)-1)])
# ---------- end python_4 ----------
crv_3 = Curve(python_3.travel)
crv_4 = Curve(python_3.lines)
srf = Surface(python_3.print_bed)
geo_3 = Geometry(python_4.new_nozzle)
panel = Panel(python_3.out)
subtraction = Subtraction(A=python_3.edge_end, B=python_3.edge_start)
pt_2 = Point(python_3.center_points)
geo_4 = Geometry(python_3.bounding_boxes)
crv_5 = Curve(python_3.connected_curve)
python_5 = GhPythonScript(tree=python_3.tree, boxes=python_3.bounding_boxes)  # -> out, a; inputs boxes: list
# ---------- python_5: Python ----------
import rhinoscriptsyntax as rs

import vertical_utils
from vertical_utils import *

def print_node_recurse(node, depth=0):
    print(depth, node.data)
    print("number of children: "+ str(len(node.children)))
    for child in node.children:
        print_node_recurse(child, depth+1)

print(tree)
print_node_recurse(tree)

width = 8

for b1 in range(len(boxes)):
    box1 = boxes[b1]
    for b2 in range(len(boxes)):
        box2 = boxes[b2]
        if b1 != b2:
            w = width/2

            bbox1 = rs.BoundingBox(box1)
            minX1 = bbox1[0].X - w
            minY1 = bbox1[0].Y - w
            maxX1 = bbox1[2].X + w
            maxY1 = bbox1[2].Y + w
            bbox2 = rs.BoundingBox(box2)
            minX2 = bbox2[0].X - w
            minY2 = bbox2[0].Y - w
            maxX2 = bbox2[2].X + w
            maxY2 = bbox2[2].Y + w
            if minX1 < maxX2 and maxX1 > minX2 and minY1 < maxY2 and maxY1 > minY2:
                print(str(b1) + " is overlapping " + str(b2))
# ---------- end python_5 ----------
vdis = VectorDisplay(Anchor=python_3.edge_start, Vector=subtraction)
cluster = Cluster(N=Slider(500, range=0..1000), B=Slider(0, range=0..15000))

# ==== cluster Cluster
C = ClusterInput()
N = ClusterInput()
B = ClusterInput()
join = JoinCurves(Curves=C, Preserve=False)
divide = DivideCurve(Curve=join, Count=N, Kinks=False)  # -> flatten(Points), Tangents, Parameters
dom = ConstructDomain(DomainStart=0, DomainEnd=B)
subset = SubList(List=divide.Points, Domain=dom, Wrap=True)  # -> List, Index
intcrv = Interpolate(Vertices=subset.List, Degree=3, Periodic=False, KnotStyle=1)  # -> Curve, Length, Domain
